# Grasshopper definition I-Section.gh (Grasshopper 1.0.8)

curve = Curve(<curve referenced from the Rhino model>)
upperflange_thickness = Slider(20, range=0..2000)
upperflange_thickness_2 = Slider(20, range=0..2000)
rotation_angle = Slider(0, range=0..360)
lowerflange_width = Slider(500, range=0..2000)
lowerflange_width_2 = Slider(500, range=0..2000)
lowerflange_thickness = Slider(20, range=0..2000)
lowerflange_thickness_2 = Slider(20, range=0..2000)
upperflange_width = Slider(500, range=0..2000)
upperflange_width_2 = Slider(500, range=0..2000)
web_thickness = Slider(20, range=0..2000)
web_thickness_2 = Slider(20, range=0..2000)
# Curve Start
web_depth = Slider(300, range=0..2000)
# Curve End
web_depth_2 = Slider(600, range=0..2000)

# ----
# Getting lower point
end_points = EndPoints(Curve=curve)  # -> Start, End
point = Point([end_points.Start, end_points.End])
deconstruct = Deconstruct(Point=point)  # -> XComponent, YComponent, ZComponent
sort_list = SortList(Keys=deconstruct.ZComponent, ValuesValuesA=deconstruct.ZComponent)  # -> Keys, ValuesValuesA
item_index = ItemIndex(List=sort_list.ValuesValuesA, Item=deconstruct.ZComponent)
list_item = ListItem(List=point, Index=item_index, Wrap=True)
list_item_2 = ListItem(List=list_item, Index=0, Wrap=True)

radians = Radians(Degrees=rotation_angle)
list_item_3 = ListItem(List=list_item, Index=1, Wrap=True)
cluster = Cluster_5(
    point=list_item_3,
    line=curve,
    number_6=web_depth_2,
    number_5=web_thickness_2,
    number_10=lowerflange_thickness_2,
    number_9=lowerflange_width_2,
    number=upperflange_thickness_2,
    number_2=upperflange_width_2)  # -> rectangle_2, rectangle_3, rectangle
cluster_2 = Cluster_4(
    point=list_item_2,
    line=curve,
    number_4=web_depth,
    number_3=web_thickness,
    number_6=lowerflange_thickness,
    number_5=lowerflange_width,
    number_2=upperflange_thickness,
    number=upperflange_width)  # -> rectangle_2, rectangle_3, rectangle
loft = Loft(
    Curves=[cluster_2.rectangle_2, cluster.rectangle_2],
    Options={Adjust=False, Closed=False, LoftEnds=0, LoftSimp=0, LoftType=0, Rebuild=10, Refit=0.01})
loft_2 = Loft(
    Curves=[cluster_2.rectangle_3, cluster.rectangle_3],
    Options={Adjust=False, Closed=False, LoftEnds=0, LoftSimp=0, LoftType=0, Rebuild=10, Refit=0.01})
loft_3 = Loft(
    Curves=[cluster_2.rectangle, cluster.rectangle],
    Options={Adjust=False, Closed=False, LoftEnds=0, LoftSimp=0, LoftType=0, Rebuild=10, Refit=0.01})
rotate = Rotate(Geometry=[loft, loft_2, loft_3], Angle=radians, Plane=PlaneXY(0, 0, 0))  # -> Geometry, Transform

# ==== cluster Cluster_4
point = ClusterInput()
line = ClusterInput()
number = ClusterInput()
number_2 = ClusterInput()
number_3 = ClusterInput()
number_4 = ClusterInput()
number_5 = ClusterInput()
number_6 = ClusterInput()
# Upper Flange
number_7 = Number(number_2)
number_8 = Number(number)
line_2 = Line(line)
point_2 = Point(point)
cluster = Cluster_2(origin=point_2, z_axis=line_2, A_2=number_7, x_size=number_7, y_size=number_8, A=number_8)
rectangle = ClusterOutput(cluster)
number_9 = Number(number_3)
number_10 = Number(number_4)
# Web
cluster_2 = Cluster(origin=point_2, z_axis=line_2, A_2=number_10, B=number_7, x_size=number_10, y_size=number_9, A=number_9)
rectangle_2 = ClusterOutput(cluster_2)
number_11 = Number(number_5)
number_12 = Number(number_6)
# Lower Flange
cluster_3 = Cluster_3(origin=point_2, z_axis=line_2, A=number_10, B=number_12, B_2=number_7, x_size=number_12, y_size=number_11, A_2=number_11)
rectangle_3 = ClusterOutput(cluster_3)

# ==== cluster Cluster_5
number = ClusterInput()
number_2 = ClusterInput()
line = ClusterInput()
point = ClusterInput()
# Upper Flange
number_3 = Number(number)
number_4 = Number(number_2)
line_2 = Line(line)
point_2 = Point(point)
cluster = Cluster_2(origin=point_2, z_axis=line_2, A_2=number_3, x_size=number_3, y_size=number_4, A=number_4)
number_5 = ClusterInput()
number_6 = ClusterInput()
rectangle = ClusterOutput(cluster)
number_7 = Number(number_5)
number_8 = Number(number_6)
# Web
cluster_2 = Cluster(origin=point_2, z_axis=line_2, A_2=number_8, B=number_3, x_size=number_8, y_size=number_7, A=number_7)
rectangle_2 = ClusterOutput(cluster_2)
number_9 = ClusterInput()
number_10 = ClusterInput()
number_11 = Number(number_9)
number_12 = Number(number_10)
# Lower Flange
cluster_3 = Cluster_3(origin=point_2, z_axis=line_2, A=number_8, B=number_12, B_2=number_3, x_size=number_12, y_size=number_11, A_2=number_11)
rectangle_3 = ClusterOutput(cluster_3)

# ==== cluster Cluster
origin = ClusterInput()
z_axis = ClusterInput()
A = ClusterInput()
A_2 = ClusterInput()
plane_normal = PlaneNormal(Origin=origin, ZAxis=z_axis)
division = Division(A=A, B=-2)
multiplication = Multiplication(A=A_2, B=-1)
B = ClusterInput()
deconstruct_plane = DeconstructPlane(Plane=plane_normal)  # -> Origin, XAxis, YAxis, ZAxis
subtraction = Subtraction(A=multiplication, B=B)
plane_origin = PlaneOrigin(Base=plane_normal, Origin=deconstruct_plane.Origin)
amplitude = Amplitude(Vector=deconstruct_plane.XAxis, Amplitude=subtraction)
amplitude_2 = Amplitude(Vector=deconstruct_plane.YAxis, Amplitude=division)
move = Move(Geometry=plane_origin, Motion=amplitude)  # -> Geometry, Transform
move_2 = Move(Geometry=move.Geometry, Motion=amplitude_2)  # -> Geometry, Transform
x_size = ClusterInput()
y_size = ClusterInput()
rectangle = Rectangle(Plane=move_2.Geometry, XSize=x_size, YSize=y_size, Radius=0)  # -> Rectangle, Length
rectangle_2 = ClusterOutput(rectangle.Rectangle)

# ==== cluster Cluster_2
A = ClusterInput()
origin = ClusterInput()
z_axis = ClusterInput()
division = Division(A=A, B=-2)
plane_normal = PlaneNormal(Origin=origin, ZAxis=z_axis)
A_2 = ClusterInput()
multiplication = Multiplication(A=A_2, B=-1)
deconstruct_plane = DeconstructPlane(Plane=plane_normal)  # -> Origin, XAxis, YAxis, ZAxis
plane_origin = PlaneOrigin(Base=plane_normal, Origin=deconstruct_plane.Origin)
amplitude = Amplitude(Vector=deconstruct_plane.YAxis, Amplitude=division)
amplitude_2 = Amplitude(Vector=deconstruct_plane.XAxis, Amplitude=multiplication)
move = Move(Geometry=plane_origin, Motion=amplitude_2)  # -> Geometry, Transform
move_2 = Move(Geometry=move.Geometry, Motion=amplitude)  # -> Geometry, Transform
x_size = ClusterInput()
y_size = ClusterInput()
rectangle = Rectangle(Plane=move_2.Geometry, XSize=x_size, YSize=y_size, Radius=0)  # -> Rectangle, Length
rectangle_2 = ClusterOutput(rectangle.Rectangle)

# ==== cluster Cluster_3
A = ClusterInput()
multiplication = Multiplication(A=A, B=-1)
B = ClusterInput()
A_2 = ClusterInput()
subtraction = Subtraction(A=multiplication, B=B)
origin = ClusterInput()
z_axis = ClusterInput()
division = Division(A=A_2, B=-2)
B_2 = ClusterInput()
plane_normal = PlaneNormal(Origin=origin, ZAxis=z_axis)
subtraction_2 = Subtraction(A=subtraction, B=B_2)
deconstruct_plane = DeconstructPlane(Plane=plane_normal)  # -> Origin, XAxis, YAxis, ZAxis
plane_origin = PlaneOrigin(Base=plane_normal, Origin=deconstruct_plane.Origin)
amplitude = Amplitude(Vector=deconstruct_plane.XAxis, Amplitude=subtraction_2)
amplitude_2 = Amplitude(Vector=deconstruct_plane.YAxis, Amplitude=division)
move = Move(Geometry=plane_origin, Motion=amplitude)  # -> Geometry, Transform
move_2 = Move(Geometry=move.Geometry, Motion=amplitude_2)  # -> Geometry, Transform
x_size = ClusterInput()
y_size = ClusterInput()
rectangle = Rectangle(Plane=move_2.Geometry, XSize=x_size, YSize=y_size, Radius=0)  # -> Rectangle, Length
rectangle_2 = ClusterOutput(rectangle.Rectangle)
